# Grasshopper definition Torus.gh (Grasshopper 1.0.7)
# plug-ins: MeshEdit Components

# ---- group: RH_IN:radius1
radius1 = Slider(40, range=10..100)

# ---- group: RH_IN:radius2
radius2 = Slider(25, range=10..100)

# ---- group: RH_IN:amplitude
amplitude = Slider(6, range=1..8)

# ----
radius1_2 = GetNumber(radius1, AtLeast=1, AtMost=1, Maximum=1.797693135e+308, Minimum=-1.797693135e+308)
radius2_2 = GetNumber(radius2, AtLeast=1, AtMost=1, Maximum=1.797693135e+308, Minimum=-1.797693135e+308)
amplitude_2 = GetNumber(amplitude, AtLeast=1, AtMost=1, Maximum=1.797693135e+308, Minimum=-1.797693135e+308)
number_slider = Slider(50, range=0..100)
xy = XYPlane(Origin=Point(0, 0, 0))
subtraction = Subtraction(A=number_slider, B="1")
subtraction_2 = Subtraction(A=number_slider, B="1")
pi = Pi(Factor=Slider(4, range=0..10))
pi_2 = Pi(Factor=Slider(4, range=0..10))
ellipse = Ellipse(Plane=xy, Radius1=radius1_2, Radius2=radius2_2)  # -> Ellipse, Focus1, Focus2
range = Range(Domain=pi, Steps=subtraction)
range_2 = Range(Domain=pi_2, Steps=subtraction_2)
area = Area(Geometry=ellipse.Ellipse)  # -> Area, Centroid
cos = Cosine(Value=range)
cos_2 = Cosine(Value=range_2)
scale = Scale(Geometry=ellipse.Ellipse, Center=area.Centroid, Factor=Slider(0.5, range=0..1))  # -> Geometry, Transform
multiplication = Multiplication(A=cos, B=amplitude_2)
multiplication_2 = Multiplication(A=cos_2, B=amplitude_2)
divide = DivideCurve(Curve=scale.Geometry, Count=number_slider, Kinks=False)  # -> Points, Tangents, Parameters
divide_2 = DivideCurve(Curve=ellipse.Ellipse, Count=number_slider, Kinks=False)  # -> Points, Tangents, Parameters
Z = UnitZ(Factor=multiplication)
Z_2 = UnitZ(Factor=multiplication_2)
move = Move(Geometry=divide.Points, Motion=Z)  # -> Geometry, Transform
move_2 = Move(Geometry=divide_2.Points, Motion=Z_2)  # -> Geometry, Transform
intcrv = Interpolate(Vertices=move.Geometry, Degree=3, Periodic=invert(False), KnotStyle=1)  # -> Curve, Length, Domain
intcrv_2 = Interpolate(Vertices=move_2.Geometry, Degree=3, Periodic=invert(False), KnotStyle=1)  # -> Curve, Length, Domain
number_slider_2 = Slider(50, range=0..100)
divide_3 = DivideCurve(Curve=intcrv_2.Curve, Count=number_slider_2, Kinks=False)  # -> Points, Tangents, Parameters
divide_4 = DivideCurve(Curve=intcrv.Curve, Count=number_slider_2, Kinks=False)  # -> Points, Tangents, Parameters
Z_3 = UnitZ(Factor=1)
arc = ArcSED(Start=divide_4.Points, End=divide_3.Points, Direction=Z_3)  # -> Arc, Plane, Radius
multiplication_3 = Multiplication(A=arc.Radius, B="0.75")
modarc = ModifiedArc(Arc=arc.Arc, Radius=multiplication_3)
midpt = CurveMiddle(Curve=modarc)
arc_2 = ArcSED(Start=divide_3.Points, End=midpt, Direction=Z_3)  # -> Arc, Plane, Radius
loft_opt = LoftOptions(Closed=Toggle(True), Adjust=False, Rebuild=0, Refit=0, Type=0)
loft = Loft(Curves=arc_2.Arc, Options=loft_opt)
debrep = DeconstructBrep(Brep=loft)  # -> Faces, Edges, Vertices
srf = Surface(debrep.Faces)
mesh_uv = MeshSurface(Surface=srf, UCount=Slider(60, range=0..100), VCount=5, Overhang=True, Equalize=False)
triangulate = MeshTriangulate(Mesh=mesh_uv, ShortDiagonal=True)
faceb = FaceBoundaries(Mesh=triangulate)  # -> flatten(Boundaries)
pcen = PolygonCenter(Polyline=faceb)  # -> CenterV, CenterE, CenterA
srf_cp = SurfaceClosestPoint(Point=pcen.CenterV, Surface=srf)  # -> Point, UVPoint, Distance
evalsrf = EvaluateSurface(Surface=srf, Point=srf_cp.UVPoint)  # -> Point, Normal, UDirection, VDirection, Frame
dom = ConstructDomain(DomainStart=Slider(0.8, range=0..1), DomainEnd=Slider(0.2, range=0..1))
lng = ListLength(List=faceb)  # -> flatten(Length)
random = Random(Range=dom, Number=lng, Seed=2)
scale_2 = Scale(Geometry=faceb, Center=pcen.CenterV, Factor=random)  # -> Geometry, Transform
amp = Amplitude(Vector=evalsrf.Normal, Amplitude=Slider(1, range=0..1))
scale_3 = Scale(Geometry=faceb, Center=pcen.CenterV, Factor=Slider(0.5, range=0..1))  # -> Geometry, Transform
move_3 = Move(Geometry=scale_2.Geometry, Motion=amp)  # -> Geometry, Transform
loft_opt_2 = LoftOptions(Closed=False, Adjust=False, Rebuild=0, Refit=0, Type=Slider(3, range=0..10))
merge = Merge(Data1=graft(faceb), Data2=graft(scale_3.Geometry), Data3=graft(move_3.Geometry))
loft_2 = Loft(Curves=merge, Options=loft_opt_2)
smesh = SimpleMesh(Brep=loft_2)
faceb_2 = FaceBoundaries(Mesh=smesh)  # -> flatten(Boundaries)
curvepoint = PointOnCurve(faceb_2, parameter=0.5)
pt = ConstructPoint(XCoordinate=0, YCoordinate=0, ZCoordinate=0)
len = Length(Curve=faceb_2)
pull = PullPoint(Point=curvepoint, Geometry=pt, ClosestOnly=True)  # -> ClosestPoint, Distance
bnd = Bounds(Numbers=pull.Distance)
remap = RemapNumbers(Value=pull.Distance, Source=bnd, Target=Domain(0, 1))  # -> Mapped, Clipped
expression = Expression(x=len, Expression="Format(\"{0}\", x)")
gradient = Gradient(
    LowerLimit=0,
    UpperLimit=1,
    Parameter=remap.Mapped,
    stops=[0: RGB(0, 0, 139), 0.328: RGB(72, 61, 139), 0.703: RGB(123, 104, 238), 1: RGB(192, 192, 255), 1: RGB(230, 230, 250)])
c_script = CSharpScript(crv=faceb_2, color=gradient, length=expression)  # -> out, A; inputs crv: Curve, color: Color, length: String
# ---------- c_script: C# ----------
    var c = color.R + "," + color.G + "," + color.B;
    crv.SetUserString("color", c);
    crv.SetUserString("length", length);
    A = crv;
# ---------- end c_script ----------

# ---- group: RH_OUT:edges
curve = Curve(flatten(c_script.A))
